# Grasshopper definition Save_Load.gh (Grasshopper 1.0.7)
# plug-ins: jSwan

# ----
# Lines into json
line = Line(Line((0, 0, 0), (10, 0, 0)))
rejson = SerializeJson(Curves=line, IncludeNullAndEmptyProperties=False)
dejson = DeserializeJson(JSON=rejson, OutputsLocked=False)
panel = Panel(rejson)
dejson_2 = DeserializeJson(JSON=dejson, OutputsLocked=False)  # -> From, FromX, FromY, FromZ, To, ToX, ToY, ToZ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
panel_2 = Panel(dejson)
panel_3 = Panel(dejson_2.From)
panel_4 = Panel(dejson_2.To)
panel_5 = Panel(dejson_2.Direction)
panel_6 = Panel(dejson_2.FromX)
panel_7 = Panel(dejson_2.FromZ)
panel_8 = Panel(dejson_2.ToX)
panel_9 = Panel(dejson_2.ToZ)
panel_10 = Panel(dejson_2.Length)
panel_11 = Panel(dejson_2.FromY)
panel_12 = Panel(dejson_2.ToY)
panel_13 = Panel(dejson_2.IsValid)
panel_14 = Panel(dejson_2.UnitTangent)
panel_15 = Panel(dejson_2.BoundingBox)
python = GhPythonScript(x=panel_3)  # -> a
# ---------- python: Python ----------
__author__ = "SKIKK"
__version__ = "2022.12.07"

import rhinoscriptsyntax as rs
import re

a = re.findall(r'\d+\.\d*', x)
# ---------- end python ----------
# From json through regexp to Rhino
panel_16 = Panel(python)

crv = Curve(<curve referenced from the Rhino model>)
rejson_2 = SerializeJson(Curves=crv, IncludeNullAndEmptyProperties=False)
dejson_3 = DeserializeJson(JSON=rejson_2, OutputsLocked=False)
panel_17 = Panel(rejson_2)
panel_18 = Panel(dejson_3)
# Curves into json
dejson_4 = DeserializeJson(JSON=dejson_3, OutputsLocked=False)  # -> Version, Archive3dm, Opennurbs, Data
# Can't recreate
# Curves from json
crv_2 = Curve(panel_18)

# ----
# Point Coordinates
number_slider = Slider(0, range=0..10)
# jSwan
# Save and Load Point
pt = ConstructPoint(XCoordinate=Slider(0, range=0..10), YCoordinate=number_slider, ZCoordinate="0")

panel_19 = Panel("C:\University\3. Semester\Artificial Ossification\json\Test_Point.json")
pt_2 = Point(pt)
move_pt = GhPythonScript(Input_Pt=pt_2)  # -> New_Pt; inputs Input_Pt: Point3d
# ---------- move_pt: Python ----------
__author__ = "SKIKK"
__version__ = "2022.12.06"

import rhinoscriptsyntax as rs
import json
import Grasshopper as gh

Point = Input_Pt

New_Pt = Point
# ---------- end move_pt ----------
rejson_3 = SerializeJson(Points=pt_2, IncludeNullAndEmptyProperties=False)
save = Button()
load = BooleanToggle(False)
save_2 = Button()
save_3 = BooleanToggle(False)
save_4 = GhPythonScript(Input_Pt=move_pt, Save=[save_3, save_2])  # inputs Input_Pt: Point3d
# ---------- save_4: Python ----------
__author__ = "SKIKK"
__version__ = "2022.12.06"

import rhinoscriptsyntax as rs
import json
import Grasshopper as gh

Point = Input_Pt

if Save:
    jsonOut = open(r"C:\University\3. Semester\Artificial Ossification\json\Test_Point.json","w")
    json.dump(Point,jsonOut)
    jsonOut.close()
# ---------- end save_4 ----------
save_5 = GhPythonScript(json_input=rejson_3, Save=save, path=panel_19)
# ---------- save_5: Python ----------
__author__ = "SKIKK"
__version__ = "2022.12.06"

import rhinoscriptsyntax as rs
import json
import Grasshopper as gh

if Save:
    
    jsonOut = open(r"{}".format(path),"w")
    json.dump(json_input,jsonOut)
    jsonOut.close()
# ---------- end save_5 ----------
panel_20 = Panel(rejson_3)
load_2 = GhPythonScript(path=panel_19, Load=load)  # -> json_output
# ---------- load_2: Python ----------
__author__ = "SKIKK"
__version__ = "2022.12.06"

import rhinoscriptsyntax as rs
import json

if Load:
    
    jsonFile = open(r"{}".format(path))
    
    json_output = json.load(jsonFile)
    jsonFile.close()
# ---------- end load_2 ----------
python_2 = GhPythonScript(x=rejson_3)  # -> a
# ---------- python_2: Python ----------
__author__ = "SKIKK"
__version__ = "2022.12.06"

import rhinoscriptsyntax as rs
import json

a = x
# ---------- end python_2 ----------
python_3 = GhPythonScript(x=rejson_3)  # -> a
# ---------- python_3: Python ----------
__author__ = "SKIKK"
__version__ = "2022.12.06"

import rhinoscriptsyntax as rs
import json

a = x.d1[0]
# ---------- end python_3 ----------
dejson_5 = DeserializeJson(JSON=panel_20, OutputsLocked=False)
dejson_6 = DeserializeJson(JSON=load_2, OutputsLocked=False)
panel_21 = Panel(pt_2)
panel_22 = Panel(rejson_3)
panel_23 = Panel(dejson_5)
panel_24 = Panel(python_2)
panel_25 = Panel(python_3)
panel_26 = Panel(dejson_6)
panel_27 = Panel(load_2)
dejson_7 = DeserializeJson(JSON=panel_23, OutputsLocked=False)  # -> X, Y, Z
dejson_8 = DeserializeJson(JSON=panel_26, OutputsLocked=False)  # -> X, Y, Z
panel_28 = Panel(dejson_7.X)
panel_29 = Panel(dejson_7.Y)
panel_30 = Panel(dejson_7.Z)
panel_31 = Panel(dejson_8.X)
panel_32 = Panel(dejson_8.Y)
panel_33 = Panel(dejson_8.Z)
pt_3 = ConstructPoint(XCoordinate=panel_28, YCoordinate=panel_29, ZCoordinate=panel_30)
pt_4 = ConstructPoint(XCoordinate=panel_31, YCoordinate=panel_32, ZCoordinate=panel_33)

pt_5 = Point(pt)
pt_6 = Point(pt)
# Multiple Points in json
pdecon = Deconstruct(Point=pt_5)  # -> XComponent, YComponent, ZComponent
pdecon_2 = Deconstruct(Point=pt_6)  # -> XComponent, YComponent, ZComponent
dejson_9 = DeserializeJson(JSON=pt_6, OutputsLocked=False)
rejson_4 = SerializeJson(Point=pt_6, IncludeNullAndEmptyProperties=False)
rejson_5 = SerializeJson(X=pdecon.XComponent, Y=pdecon.YComponent, Z=pdecon.ZComponent, IncludeNullAndEmptyProperties=False)
rejson_6 = SerializeJson(X=pdecon_2.XComponent, Y=pdecon_2.YComponent, Z=pdecon_2.ZComponent, IncludeNullAndEmptyProperties=False)
dejson_10 = DeserializeJson(JSON=rejson_4, OutputsLocked=False)
rejson_7 = SerializeJson(Points=[pt_5, pt_6], Coordinates=[rejson_5, rejson_6], IncludeNullAndEmptyProperties=False)
dejson_11 = DeserializeJson(JSON=dejson_10, OutputsLocked=False)  # -> X, Y, Z
panel_34 = Panel(rejson_7)

# ----
# y - Coordinate
panel_35 = Panel("""20
10
8
19""")
# z - Coordinate
panel_36 = Panel("""18
2
32
-10""")
# x - Coordinate
panel_37 = Panel("""15
0
-13
20""")
# Point Number - n
panel_38 = Panel("""0
1
2
3""")
python_4 = GhPythonScript(x="5", y="10", z="0", n="1")  # -> out, point
# ---------- python_4: Python ----------
point = [n,x,y,z]
# ---------- end python_4 ----------
python_5 = GhPythonScript(x=panel_37, y=panel_35, z=panel_36, n=panel_38)  # -> out, point; same code as python_4
# Point Array - n, x, y, z
python_6 = GhPythonScript(x=panel_37, y=panel_35, z=panel_36, n=panel_38)  # -> out, point
# ---------- python_6: Python ----------
point = [n, x, y, z]
# ---------- end python_6 ----------
python_7 = GhPythonScript()  # -> test123, test_array
# ---------- python_7: Python ----------
test_array = ["Karl", "Klaus", "Dieter", ["Thorsten", "Jamal", "Emilia"]]
output = test_array
test123 = 1
# ---------- end python_7 ----------
panel_39 = Panel(python_7.test123)
panel_40 = Panel(python_7.test_array)
panel_41 = Panel(python_4.point)
panel_42 = Panel(python_5.point)
python_8 = GhPythonScript(test_array=python_7.test_array)  # -> out, a, b, c
# ---------- python_8: Python ----------
a = test_array[0] # gibt den ersten Buchstaben aus
b = test_array[1]
c = test_array
# ---------- end python_8 ----------
point_number = Slider(2, range=0..3)
panel_43 = Panel(python_8.a)
panel_44 = Panel(python_8.b)
panel_45 = Panel(python_8.c)
list = ValueList({"n": 0, "x": 1, "y": 2, "z": 3}, selected="n")
python_9 = GhPythonScript(point=python_5.point, n=Slider(0, range=0..3))  # -> out, a, b; inputs n: Int32
# ---------- python_9: Python ----------
a = point[n]
b = point
# ---------- end python_9 ----------
python_10 = GhPythonScript(point=python_6.point, n1=list, n2=point_number)  # -> out, a, b; inputs point: tree of Int32, n1: Int32, n2: Int32
# ---------- python_10: Python ----------
import ghpythonlib.treehelpers as th

outputList1 = []
outputList2 = []
#pyList = [list(i) for i in point.Branches]
pyList = th.tree_to_list(point)

print point.Branch(0)
print len(pyList)
print range(len(pyList))

for j in range(len(pyList)):
    p = pyList[j][n1]
    outputList1.append(p)

for k in range(len(pyList[n2])):
    q = pyList[n2][k]
    outputList2.append(q)

a = outputList1
#b = point.Branch(0)
b = outputList2
# ---------- end python_10 ----------
python_11 = GhPythonScript(c=panel_45)  # -> out, test_array
# ---------- python_11: Python ----------
test_array = c
# ---------- end python_11 ----------
panel_46 = Panel(python_11.test_array)
panel_47 = Panel(python_10.a)
panel_48 = Panel(python_10.b)
panel_49 = Panel(python_9.a)
panel_50 = Panel(python_9.b)
panel_51 = Panel(python_6.point)

# ----
# Python Arrays
# Python - Grasshopper
# Array Interaction
panel_52 = Panel("Valentin")
python_12 = GhPythonScript(name=panel_52)  # -> test_array, name_3
# ---------- python_12: Python ----------
__author__ = "SKIKK"
__version__ = "2022.12.09"

import rhinoscriptsyntax as rs

test_array = ["Hans", name, "Klaus", "Murat"]
name_3 = test_array[2]
# ---------- end python_12 ----------
panel_53 = Panel(python_12.name_3)
panel_54 = Panel(python_12.test_array)

# ----
# Default Class Parameters Test
python_13 = GhPythonScript()
# ---------- python_13: Python ----------
__author__ = "SKIKK"
__version__ = "2023.01.10"

class TestClass:
    def __init__(self, normal, default = 1):
        default = normal
        print("normal: "+ str(normal)+ " default: "+ str(default))

TestClass(3)
# ---------- end python_13 ----------

# ----
# Load and Save Path
panel_55 = Panel("C:\University\3. Semester\Artificial Ossification\json\")
# Working Load and Save Python Script
pop3d = Populate3D(
    Region={Plane=PlaneXY(0, 0, 0), X=Domain(0, 10), Y=Domain(0, 10), Z=Domain(0, 2)},
    Count=Slider(10, range=0..20),
    Seed=Slider(0, range=0..20))
pop3d_2 = Populate3D(
    Region={Plane=PlaneXY(0, 0, 0), X=Domain(0, 10), Y=Domain(0, 10), Z=Domain(0, 2)},
    Count=Slider(10, range=0..20),
    Seed=Slider(1, range=0..20))
osteoblasts = Point(pop3d)
osteoclasts = Point(pop3d_2)
# Input Objects
osteoblasts_2 = Point([<point referenced from the Rhino model> x4])
osteoclasts_2 = Point([<point referenced from the Rhino model> x5])
curves = Curve([<curve referenced from the Rhino model> x2])
load_3 = BooleanToggle(False)
save_6 = Button()
panel_56 = Panel(osteoblasts_2)
save_load = GhPythonScript(
    osteoblasts=osteoblasts_2,
    osteoclasts=osteoclasts_2,
    geometry=curves,
    Save=save_6,
    Load=load_3,
    path=panel_55,
    file_name="Osteoblasts_Osteoclasts")  # -> out, test, coordinates, out_osteoblasts, out_osteoclasts, out_geometry; inputs osteoblasts: list of Point3d, osteoclasts: list of Point3d, geometry: list of Curve
# ---------- save_load: Python ----------
import rhinoscriptsyntax as rs
import ghpythonlib.treehelpers as gt
import json


# List Osteoblast Coordinates
px = []
py = []
pz = []

for i in osteoblasts:
    px.append(i.X)
    py.append(i.Y)
    pz.append(i.Z)

l_osteoblasts = []
for j in range(len(osteoblasts)):
    l_osteoblasts.append([px[j], py[j], pz[j]])



# List Osteoclast Coordinates
px = []
py = []
pz = []

for i in osteoclasts:
    px.append(i.X)
    py.append(i.Y)
    pz.append(i.Z)

l_osteoclasts = []
for j in range(len(osteoclasts)):
    l_osteoclasts.append([px[j], py[j], pz[j]])



# List Lines
sp = []
ep = []
l_geometry = []

for m in range(len(geometry)):
    sp.append(rs.CurveStartPoint(geometry[m]))
    ep.append(rs.CurveEndPoint(geometry[m]))
    l_geometry.append([[sp[m].X, sp[m].Y, sp[m].Z], [ep[m].X, ep[m].Y, ep[m].Z]])
print(sp[0].X)

# Save Data
json_content_save = [l_osteoblasts, l_osteoclasts, l_geometry]

if Save:
    
    jsonOut = open(r"{}{}.json".format(path,file_name),"w")
    json.dump(json_content_save,jsonOut)
    jsonOut.close()



# Load Data
json_content_load = []

if Load:
    jsonFile = open(r"{}{}.json".format(path,file_name))
    pyList = json.load(jsonFile)
    jsonFile.close()
    json_content_load = gt.list_to_tree(pyList)
    
    coordinates = json_content_load
    
    # Output Points
    c_points = gt.tree_to_list(json_content_load)
    c_blasts = c_points[0]
    c_clasts = c_points[1]
    
    out_osteoblasts = []
    for k in range(len(c_blasts)):
        points = rs.AddPoint(c_blasts[k])
        out_osteoblasts.append(points)
    
    out_osteoclasts = []
    for l in range(len(c_clasts)):
        points = rs.AddPoint(c_clasts[l])
        out_osteoclasts.append(points)
    
    test = gt.list_to_tree([out_osteoblasts, out_osteoclasts])
    
    # Output Lines
    c_lines = c_points[2]
    
    out_geometry = []
    for n in range(len(c_lines)):
        out_geometry.append(rs.AddLine(c_lines[n][0], c_lines[n][1]))
# ---------- end save_load ----------
pt_7 = Point(save_load.out_osteoblasts)
pt_8 = Point(save_load.out_osteoclasts)
# Output Objects
line_2 = Line(save_load.out_geometry)
simplify = SimplifyTree(Tree=save_load.coordinates, Front=False)
panel_57 = Panel(simplify)
panel_58 = Panel(save_load.test)

# ----
# Save & Load Values
panel_59 = Panel("C:\University\3. Semester\Artificial Ossification\json\")
# Save & Load Geometry
panel_60 = Panel("C:\University\3. Semester\Artificial Ossification\json\")
panel_61 = Panel("C:\University\3. Semester\Artificial Ossification\json\")
panel_62 = Panel("PickleTestData_Geometry")
# Save & Load Geometry
# inside of Classes
panel_63 = Panel("PickleTestData_Geometry")
# Load from File
toggle = BooleanToggle(True)
osteoblasts_3 = Point([<point referenced from the Rhino model> x4])
osteoblasts_4 = Point([<point referenced from the Rhino model> x4])
osteoclasts_3 = Point([<point referenced from the Rhino model> x5])
osteoclasts_4 = Point([<point referenced from the Rhino model> x5])
curves_2 = Curve([<curve referenced from the Rhino model> x2])
curves_3 = Curve([<curve referenced from the Rhino model> x2])
python_14 = GhPythonScript(Load=toggle, path=panel_61, file_name=panel_62)  # -> out, loaded
# ---------- python_14: Python ----------
__author__ = "SKIKK"
__version__ = "2023.01.07"

import rhinoscriptsyntax as rs
import pickle

if Load:
    infile = open(r"{}{}.json".format(path,file_name),'rb')
    loaded = pickle.load(infile)
# ---------- end python_14 ----------
python_15 = GhPythonScript(
    osteoblasts=osteoblasts_3,
    osteoclasts=osteoclasts_3,
    geometry=curves_2,
    Save=Button(),
    Load=Toggle(False),
    path=panel_60,
    file_name=panel_63)  # -> input, loaded, p1, p2, g1; inputs osteoblasts: list of Point3d, osteoclasts: list of Point3d, geometry: list of Curve
# ---------- python_15: Python ----------
__author__ = "SKIKK"
__version__ = "2023.01.07"

import rhinoscriptsyntax as rs
import pickle

b = osteoblasts
c = osteoclasts
g = geometry
input = [b,c,g]

s = pickle.dumps(input)

l = pickle.loads(s)

if Save:
    outfile = open(r"{}{}.json".format(path,file_name),'wb')
    pickle.dump(input, outfile)
    outfile.close()

if Load:
    infile = open(r"{}{}.json".format(path,file_name),'rb')
    loaded = pickle.load(infile)
    
    p1 = loaded[0]
    p2 = loaded[1]
    g1 = loaded[2]
# ---------- end python_15 ----------
python_16 = GhPythonScript(
    osteoblasts=osteoblasts_4,
    osteoclasts=osteoclasts_4,
    geometry=curves_3,
    Save=Button(),
    Load=Toggle(False),
    path=panel_61,
    file_name=panel_62)  # -> input, loaded, p1, p2, g1; inputs osteoblasts: list of Point3d, osteoclasts: list of Point3d, geometry: list of Curve
# ---------- python_16: Python ----------
__author__ = "SKIKK"
__version__ = "2023.01.07"

import rhinoscriptsyntax as rs
import pickle

class TestClass():
    def __init__(self, b = osteoblasts, c = osteoclasts, g = geometry):
        self.b = b
        self.c = c
        self.g = g

input = TestClass()
print(vars(input))

#s = pickle.dumps(input)

#l = pickle.loads(s)

if Save:
    outfile = open(r"{}{}.json".format(path,file_name),'wb')
    pickle.dump(input, outfile)
    outfile.close()

if Load:
    infile = open(r"{}{}.json".format(path,file_name),'rb')
    loaded = pickle.load(infile)
    
    #p1 = loaded.b
    #p2 = loaded.c
    #g1 = loaded.g
# ---------- end python_16 ----------
# Pickle
python_17 = GhPythonScript(
    x=Slider(8, range=0..10),
    y=Slider(6, range=0..10),
    z=Slider(2, range=0..10),
    Save=Button(),
    Load=Toggle(False),
    path=panel_59,
    file_name="PickleTestData")  # -> input, loaded; inputs x: Int32, y: Int32, z: Int32
# ---------- python_17: Python ----------
__author__ = "SKIKK"
__version__ = "2023.01.06"

import rhinoscriptsyntax as rs
import pickle

d = [x, y, z]
print(d)
input = d

s = pickle.dumps(d)

l = pickle.loads(s)

if Save:
    outfile = open(r"{}{}.json".format(path,file_name),'wb')
    pickle.dump(d, outfile)
    outfile.close()

if Load:
    infile = open(r"{}{}.json".format(path,file_name),'rb')
    loaded = pickle.load(infile)

print(loaded)
# ---------- end python_17 ----------
panel_64 = Panel(python_14.loaded)
panel_65 = Panel(python_17.input)
panel_66 = Panel(python_17.loaded)
pt_9 = Point(python_15.p1)
pt_10 = Point(python_15.p2)
crv_3 = Curve(python_15.g1)
pt_11 = Point(python_16.p1)
pt_12 = Point(python_16.p2)
crv_4 = Curve(python_16.g1)
panel_67 = Panel(python_15.input)
panel_68 = Panel(python_15.loaded)
panel_69 = Panel(python_16.input)
panel_70 = Panel(python_16.loaded)
pt_13 = Point(<point referenced from the Rhino model>)
panel_71 = Panel("C:\University\3. Semester\Artificial Ossification\json\")
# Save & Load Karamba Loads
panel_72 = Panel("PickleLoadPt")
python_18 = GhPythonScript(Load_pt=pt_13)  # -> GH_Load; inputs Load_pt: Point3d
# ---------- python_18: Python ----------
__author__ = "SKIKK"
__version__ = "2023.01.10"

import Rhino.Geometry as rg
import rhinoscriptsyntax as rs
import clr
clr.AddReferenceToFileAndPath("C:\Program Files\Rhino 6\Plug-ins\Karamba\Karamba.gha")
clr.AddReferenceToFileAndPath("C:\Program Files\Rhino 6\Plug-ins\Karamba\KarambaCommon.dll")
import Karamba as ka
import Karamba.GHopper as kagh

GH_Load = []

f = kagh.Geometry.GeometryExtensions.Convert(rg.Vector3d(0,0,-100))
m = kagh.Geometry.GeometryExtensions.Convert(rg.Vector3d(0,0,0))
ka_point = kagh.Geometry.GeometryExtensions.Convert(Load_pt)
temp_load = ka.Loads.PointLoad(ka_point, f, m, 0, False)
print(type(temp_load))
for i in range(30):
    GH_Load.append(kagh.Loads.GH_Load(temp_load))
print(type(GH_Load))
# ---------- end python_18 ----------
panel_73 = Panel(python_18)
toggle_2 = BooleanToggle(True)
# Save & Load PointLoad
toggle_3 = BooleanToggle(False)
# Save & Load GH_Load
python_19 = GhPythonScript(GH_Load=python_18, Save=toggle_2, Load=toggle_3, path=panel_71, file_name="GH_Load")  # -> input, loaded, loaded_GH_Load; inputs GH_Load: list
# ---------- python_19: Python ----------
__author__ = "SKIKK"
__version__ = "2023.01.07"

import rhinoscriptsyntax as rs
import clr
clr.AddReferenceToFileAndPath("C:\Program Files\Rhino 6\Plug-ins\Karamba\Karamba.gha")
clr.AddReferenceToFileAndPath("C:\Program Files\Rhino 6\Plug-ins\Karamba\KarambaCommon.dll")
import Karamba as ka
import Karamba.GHopper as kagh
import pickle

print("GH_Load: " + str(type(GH_Load[0])))

# convert to type 'GH_Load' like in the original file
xinput = []
for i in range(len(GH_Load)):
    xinput.append(kagh.Loads.GH_Load(GH_Load[i]))
print("xinput: " + str(type(xinput[0])))

# convert the type back to 'PointLoad'
input = xinput

if Save:
    outfile = open(r"{}{}.pkl".format(path,file_name),'wb')
    pickle.dump(input, outfile)
    outfile.close()

if Load:
    infile = open(r"{}{}.pkl".format(path,file_name),'rb')
    loaded = pickle.load(infile)
    print(type(loaded))
    # convert Point-load to GH_Load
    loaded_GH_Load = []
    for i in range(len(loaded)):
        loaded_GH_Load.append(kagh.Loads.GH_Load(loaded[i]))
    print(type(loaded_GH_Load))
# ---------- end python_19 ----------
python_20 = GhPythonScript(GH_Load=python_18, Save=toggle_2, Load=toggle_3, path=panel_71, file_name=panel_72)  # -> input, loaded, loaded_GH_Load; inputs GH_Load: list
# ---------- python_20: Python ----------
__author__ = "SKIKK"
__version__ = "2023.01.07"

import rhinoscriptsyntax as rs
import Karamba.GHopper as kagh
import pickle

input = GH_Load
print(type(GH_Load[0]))

#s = pickle.dumps(input)
#l = pickle.loads(s)

if Save:
    outfile = open(r"{}{}.pkl".format(path,file_name),'wb')
    pickle.dump(input, outfile)
    outfile.close()

if Load:
    infile = open(r"{}{}.pkl".format(path,file_name),'rb')
    loaded = pickle.load(infile)
    print(type(loaded))
    # convert Point-load to GH_Load
    loaded_GH_Load = []
    for i in range(len(loaded)):
        loaded_GH_Load.append(kagh.Loads.GH_Load(loaded[i]))
    print(type(loaded_GH_Load))
# ---------- end python_20 ----------
panel_74 = Panel(python_20.input)
panel_75 = Panel(python_20.loaded)
panel_76 = Panel(python_20.loaded_GH_Load)
panel_77 = Panel(python_19.input)
panel_78 = Panel(python_19.loaded)
panel_79 = Panel(python_19.loaded_GH_Load)

python_21 = GhPythonScript(
    Save=Button(),
    Load=Toggle(False),
    path="C:\University\3. Semester\Artificial Ossification\json\",
    file_name="PickleTestValues")  # -> input, loaded, p1, p2, g1; inputs osteoblasts: list of Point3d, osteoclasts: list of Point3d, geometry: list of Curve
# ---------- python_21: Python ----------
__author__ = "SKIKK"
__version__ = "2023.01.07"

import rhinoscriptsyntax as rs
import pickle

class Foo():
    def __init__(self, x, y):
        self.x = x
        self.y = y

f = Foo(10, [100, 200, 300])
print(vars(f))

if Save:
    outfile = open(r"{}{}.pkl".format(path,file_name),'wb')
    pickle.dump(f, outfile)
    outfile.close()

if Load:
    infile = open(r"{}{}.pkl".format(path,file_name),'rb')
    loaded = pickle.load(infile)
# ---------- end python_21 ----------

# ----
# Save and Load Python Array
panel_80 = Panel("C:\University\3. Semester\Artificial Ossification\json\")
load_4 = BooleanToggle(False)
load_5 = Button()
save_7 = Button()
save_8 = GhPythonScript(point=python_6.point, Save=save_7, path=panel_80, file_name="Test_Point_02")  # inputs point: tree
# ---------- save_8: Python ----------
import json

# Json Content
json_content = [list(i) for i in point.Branches]
print json_content

# Save as .json File
if Save:
    
    jsonOut = open(r"{}{}.json".format(path,file_name),"w")
    json.dump(json_content,jsonOut)
    jsonOut.close()
# ---------- end save_8 ----------
load_6 = GhPythonScript(path=panel_80, file_name="Test_Point_02", Load=load_4)  # -> json_content
# ---------- load_6: Python ----------
import json
import ghpythonlib.treehelpers as gt

if Load:
    jsonFile = open(r"{}{}.json".format(path,file_name))
    pyList = json.load(jsonFile)
    jsonFile.close()
    json_content = gt.list_to_tree(pyList)
# ---------- end load_6 ----------
panel_81 = Panel(load_6)

panel_82 = Panel(python_21.loaded)
